# Grasshopper definition box_kite.gh (Grasshopper 1.0.7)

# https://www.my-best-kite.com/box-kite-plans.html
# https://www.grc.nasa.gov/www/k-12/airplane/kitepart.html
number_slider = Slider(14.5, range=0..100)
rectangle = Rectangle(Plane=PlaneXY(0, 0, 0), XSize=number_slider, YSize=Slider(58, range=0..100), Radius=0)  # -> Rectangle, Length
box_rectangle = BoxRectangle(Rectangle=rectangle.Rectangle, Height=number_slider)
deconstruct_brep = DeconstructBrep(Brep=box_rectangle)  # -> Faces, Edges, Vertices
list_item = ListItem(List=deconstruct_brep.Faces, Index=0, Wrap=True)
xz_plane = XZPlane(Origin=Point(0, 0, 0))
rotate = Rotate(Geometry=simplify(list_item), Angle=degrees("45"), Plane=xz_plane)  # -> Geometry, Transform
panel = Panel("""7.3
21.8
36.3
50.8
58.1""")
deconstruct_brep_2 = DeconstructBrep(Brep=rotate.Geometry)  # -> Faces, Edges, Vertices
unit_y = UnitY(Factor=Slider(21.8, range=0..30))
unit_y_2 = UnitY(Factor=Slider(58.1, range=0..58.1))
unit_y_3 = UnitY(Factor=Slider(50.8, range=0..50.8))
unit_y_4 = UnitY(Factor=Slider(7.3, range=0..10))
unit_y_5 = UnitY(Factor=Slider(36.3, range=0..40))
move = Move(Geometry=deconstruct_brep_2.Edges, Motion=unit_y_4)  # -> Geometry, Transform
move_2 = Move(Geometry=deconstruct_brep_2.Vertices, Motion=unit_y_4)  # -> Geometry, Transform
move_3 = Move(Geometry=deconstruct_brep_2.Edges, Motion=unit_y)  # -> Geometry, Transform
move_4 = Move(Geometry=deconstruct_brep_2.Vertices, Motion=unit_y)  # -> Geometry, Transform
move_5 = Move(Geometry=deconstruct_brep_2.Edges, Motion=unit_y_5)  # -> Geometry, Transform
move_6 = Move(Geometry=deconstruct_brep_2.Vertices, Motion=unit_y_5)  # -> Geometry, Transform
move_7 = Move(Geometry=deconstruct_brep_2.Edges, Motion=unit_y_3)  # -> Geometry, Transform
move_8 = Move(Geometry=deconstruct_brep_2.Vertices, Motion=unit_y_3)  # -> Geometry, Transform
move_9 = Move(Geometry=deconstruct_brep_2.Edges, Motion=unit_y_2)  # -> Geometry, Transform
move_10 = Move(Geometry=deconstruct_brep_2.Vertices, Motion=unit_y_2)  # -> Geometry, Transform
line = Line(deconstruct_brep_2.Edges)
point = Point(deconstruct_brep_2.Vertices)
list_item_2 = ListItem(List=point, Index=0, Wrap=True)  # -> Item, Item1, Item2, Item3
list_item_3 = ListItem(List=move_2.Geometry, Index=0, Wrap=True)  # -> Item, Item1, Item2, Item3
list_item_4 = ListItem(List=move_4.Geometry, Index=0, Wrap=True)  # -> Item, Item1, Item2, Item3
list_item_5 = ListItem(List=move_6.Geometry, Index=0, Wrap=True)  # -> Item, Item1, Item2, Item3
list_item_6 = ListItem(List=move_8.Geometry, Index=0, Wrap=True)  # -> Item, Item1, Item2, Item3
list_item_7 = ListItem(List=move_10.Geometry, Index=0, Wrap=True)  # -> Item, Item1, Item2, Item3

# ---- group: varetas diagonais
line_2 = Line(StartPoint=list_item_3.Item, EndPoint=list_item_3.Item3)
line_3 = Line(StartPoint=list_item_3.Item1, EndPoint=list_item_3.Item2)
line_4 = Line(StartPoint=list_item_4.Item, EndPoint=list_item_4.Item3)
line_5 = Line(StartPoint=list_item_4.Item1, EndPoint=list_item_4.Item2)
line_6 = Line(StartPoint=list_item_5.Item, EndPoint=list_item_5.Item3)
line_7 = Line(StartPoint=list_item_5.Item1, EndPoint=list_item_5.Item2)
line_8 = Line(StartPoint=list_item_6.Item, EndPoint=list_item_6.Item3)
line_9 = Line(StartPoint=list_item_6.Item1, EndPoint=list_item_6.Item2)

# ---- group: varetas longitudinais
line_10 = Line(StartPoint=list_item_2.Item, EndPoint=list_item_7.Item)
line_11 = Line(StartPoint=list_item_2.Item1, EndPoint=list_item_7.Item1)
line_12 = Line(StartPoint=list_item_2.Item2, EndPoint=list_item_7.Item2)
line_13 = Line(StartPoint=list_item_2.Item3, EndPoint=list_item_7.Item3)

# ----
pipe = Pipe(
    Curve=[line_2, line_3, line_4, line_5, line_6, line_7, line_8, line_9, line_10, line_11, line_12, line_13],
    Radius=Slider(0.15, range=0..2),
    Caps=0)

list_item_8 = ListItem(List=move_3.Geometry, Index=0, Wrap=True)  # -> Item, Item1, Item2, Item3
list_item_9 = ListItem(List=line, Index=0, Wrap=True)  # -> Item, Item1, Item2, Item3
loft = Loft(
    Curves=[list_item_9.Item, list_item_8.Item],
    Options={Adjust=False, Closed=False, LoftEnds=0, LoftSimp=0, LoftType=0, Rebuild=10, Refit=0.01})
loft_2 = Loft(
    Curves=[list_item_9.Item2, list_item_8.Item2],
    Options={Adjust=False, Closed=False, LoftEnds=0, LoftSimp=0, LoftType=0, Rebuild=10, Refit=0.01})
loft_3 = Loft(
    Curves=[list_item_9.Item3, list_item_8.Item3],
    Options={Adjust=False, Closed=False, LoftEnds=0, LoftSimp=0, LoftType=0, Rebuild=10, Refit=0.01})
loft_4 = Loft(
    Curves=[list_item_9.Item1, list_item_8.Item1],
    Options={Adjust=False, Closed=False, LoftEnds=0, LoftSimp=0, LoftType=0, Rebuild=10, Refit=0.01})

list_item_10 = ListItem(List=move_9.Geometry, Index=0, Wrap=True)  # -> Item, Item1, Item2, Item3
list_item_11 = ListItem(List=move_5.Geometry, Index=0, Wrap=True)  # -> Item, Item1, Item2, Item3
loft_5 = Loft(
    Curves=[list_item_11.Item, list_item_10.Item],
    Options={Adjust=False, Closed=False, LoftEnds=0, LoftSimp=0, LoftType=0, Rebuild=10, Refit=0.01})
loft_6 = Loft(
    Curves=[list_item_11.Item2, list_item_10.Item2],
    Options={Adjust=False, Closed=False, LoftEnds=0, LoftSimp=0, LoftType=0, Rebuild=10, Refit=0.01})
loft_7 = Loft(
    Curves=[list_item_11.Item3, list_item_10.Item3],
    Options={Adjust=False, Closed=False, LoftEnds=0, LoftSimp=0, LoftType=0, Rebuild=10, Refit=0.01})
loft_8 = Loft(
    Curves=[list_item_11.Item1, list_item_10.Item1],
    Options={Adjust=False, Closed=False, LoftEnds=0, LoftSimp=0, LoftType=0, Rebuild=10, Refit=0.01})

custom_preview = CustomPreview(Geometry=[loft, loft_4, loft_2, loft_3], Material=ColourSwatch(SwatchColor=RGB(2, 31, 247)))
custom_preview_2 = CustomPreview(Geometry=[loft_5, loft_8, loft_6, loft_7], Material=ColourSwatch(SwatchColor=RGB(247, 2, 2)))
