# Grasshopper definition tetraedro.gh (Grasshopper 1.0.7)

# https://web.archive.org/web/20170524211828/http://www.ict.griffith.edu.au/anthony/kites/tetra/straw_plan/
number_slider = Slider(1.5, range=0..10)
number_slider_2 = Slider(2, range=0..10)

# ---- group: Ponto 0.0.0
construct_point = ConstructPoint(XCoordinate=0, YCoordinate=0, ZCoordinate=0)

# ---- group: Paramêtros
edge = Slider(3, range=0..20)
tetrahedron_x = Slider(5, range=0..20)
tetrahedron_y = Slider(3, range=0..20)
tetrahedron_z = Slider(3, range=0..20)
pipe_radius = Slider(0.044, range=0..20)
sphere_radius = Slider(0.241, range=0..20)

# ----
# padrões
# 
# linha 0 - aumenta em 2xT em X
# 
# linha 1 - aumenta
panel = Panel("""0,0,0
0,3,0
0,6,0
-1.5,1.5,3
1.5,1.5,3
-1.5,4.5,3
1.5,4.5,3
-3,3,6
0,3,6
3,3,6""")
negative = Negative(Value=number_slider)
multiplication = Multiplication(A=number_slider, B=number_slider_2)
unit_x = UnitX(Factor=multiplication)
multiplication_2 = Multiplication(A=multiplication, B=number_slider_2)
negative_2 = Negative(Value=unit_x)
deconstruct = Deconstruct(Point=construct_point)  # -> XComponent, YComponent, ZComponent
sqrt = SquareRoot(Value="3")
sqrt_2 = SquareRoot(Value="6")
sqrt_3 = SquareRoot(Value="3")
list_item = ListItem(List=panel, Index=0, Wrap=True)  # -> Item, Item1, Item2, Item3, Item4, Item5, Item6, Item7, Item8, Item9
unit_z = UnitZ(Factor=multiplication_2)
construct_point_2 = ConstructPoint(XCoordinate=number_slider, YCoordinate=number_slider, ZCoordinate=multiplication)
construct_point_3 = ConstructPoint(XCoordinate=negative, YCoordinate=number_slider, ZCoordinate=multiplication)
construct_point_4 = ConstructPoint(XCoordinate=0, YCoordinate=0, ZCoordinate=0)
construct_point_5 = ConstructPoint(XCoordinate=0, YCoordinate=multiplication, ZCoordinate=0)
move = Move(Geometry=construct_point_5, Motion=unit_x)  # -> Geometry, Transform
move_2 = Move(Geometry=construct_point_5, Motion=negative_2)  # -> Geometry, Transform
division = Division(A=sqrt_2, B="3")
division_2 = Division(A=sqrt_3, B="6")
division_3 = Division(A=sqrt, B="2")
multiplication_3 = Multiplication(A=edge, B=division_3)
division_4 = Division(A=edge, B="2")
multiplication_4 = Multiplication(A=edge, B=division_2)
multiplication_5 = Multiplication(A=edge, B=division)
point = Point(list_item.Item)
point_2 = Point(list_item.Item1)
point_3 = Point(list_item.Item2)
point_4 = Point(list_item.Item3)
point_5 = Point(list_item.Item4)
point_6 = Point(list_item.Item5)
point_7 = Point(list_item.Item6)
point_8 = Point(list_item.Item7)
point_9 = Point(list_item.Item8)
point_10 = Point(list_item.Item9)
construct_point_6 = ConstructPoint(XCoordinate=0, YCoordinate=0, ZCoordinate=0)

# ---- group: direita
line = Line(StartPoint=construct_point_2, EndPoint=construct_point_4)
line_2 = Line(StartPoint=construct_point_2, EndPoint=construct_point_5)

# ---- group: Eixo
line_3 = Line(StartPoint=construct_point_4, EndPoint=construct_point_5)

# ---- group: Esquerda
line_4 = Line(StartPoint=construct_point_3, EndPoint=construct_point_4)
line_5 = Line(StartPoint=construct_point_3, EndPoint=construct_point_5)

# ---- group: P3
construct_point_7 = ConstructPoint(XCoordinate=division_4, YCoordinate=multiplication_3, ZCoordinate=0)

# ----
panel_2 = Panel(construct_point_7)

# ---- group: P4
construct_point_8 = ConstructPoint(XCoordinate=division_4, YCoordinate=multiplication_4, ZCoordinate=multiplication_5)

# ----
panel_3 = Panel(construct_point_8)

# ---- group: P2
construct_point_9 = ConstructPoint(XCoordinate=edge, YCoordinate=deconstruct.YComponent, ZCoordinate=deconstruct.ZComponent)

# ----
panel_4 = Panel(construct_point_9)
move_3 = Move(Geometry=construct_point_5, Motion=unit_z)  # -> Geometry, Transform
move_4 = Move(Geometry=move.Geometry, Motion=unit_z)  # -> Geometry, Transform
move_5 = Move(Geometry=move_2.Geometry, Motion=unit_z)  # -> Geometry, Transform
line_6 = Line(StartPoint=point, EndPoint=point_2)
line_7 = Line(StartPoint=point_2, EndPoint=point_3)
line_8 = Line(StartPoint=point, EndPoint=point_4)
line_9 = Line(StartPoint=point, EndPoint=point_5)
line_10 = Line(StartPoint=point_2, EndPoint=point_4)
line_11 = Line(StartPoint=point_2, EndPoint=point_5)
line_12 = Line(StartPoint=point_3, EndPoint=point_6)
line_13 = Line(StartPoint=point_3, EndPoint=point_7)
line_14 = Line(StartPoint=point_2, EndPoint=point_6)
line_15 = Line(StartPoint=point_2, EndPoint=point_7)
line_16 = Line(StartPoint=point_4, EndPoint=point_5)
line_17 = Line(StartPoint=point_6, EndPoint=point_7)

# ---- group: LINES
ln = Line(StartPoint=construct_point, EndPoint=construct_point_9)
ln_2 = Line(StartPoint=construct_point, EndPoint=construct_point_7)
ln_3 = Line(StartPoint=construct_point, EndPoint=construct_point_8)
ln_4 = Line(StartPoint=construct_point_9, EndPoint=construct_point_7)
ln_5 = Line(StartPoint=construct_point_9, EndPoint=construct_point_8)
ln_6 = Line(StartPoint=construct_point_7, EndPoint=construct_point_8)

# ----
planar = PlanarSrf(Edges=[line, line_2, line_3])
planar_2 = PlanarSrf(Edges=[line_4, line_5, line_3])
line_18 = Line(StartPoint=point_4, EndPoint=point_8)
line_19 = Line(StartPoint=point_6, EndPoint=point_8)
line_20 = Line(StartPoint=point_4, EndPoint=point_9)
line_21 = Line(StartPoint=point_6, EndPoint=point_9)
line_22 = Line(StartPoint=point_5, EndPoint=point_10)
line_23 = Line(StartPoint=point_7, EndPoint=point_10)
line_24 = Line(StartPoint=point_5, EndPoint=point_9)
line_25 = Line(StartPoint=point_7, EndPoint=point_9)
line_26 = Line(StartPoint=point_8, EndPoint=point_9)
line_27 = Line(StartPoint=point_9, EndPoint=point_10)
line_28 = Line(StartPoint=point_5, EndPoint=point_7)
line_29 = Line(StartPoint=point_4, EndPoint=point_6)
unit_y = UnitY(Factor=multiplication)

series = Series(Start="0", Step=edge, Count=tetrahedron_x)

# ---- group: Superfície
planar_3 = PlanarSrf(Edges=[ln_2, ln_3, ln_6])
planar_4 = PlanarSrf(Edges=[ln_6, ln_4, ln_5])

# ----
point_11 = Point(construct_point_7)
move_6 = Move(Geometry=planar, Motion=unit_y)  # -> Geometry, Transform
deconstruct_brep = DeconstructBrep(Brep=move_6.Geometry)  # -> Faces, Edges, Vertices
list_item_2 = ListItem(List=deconstruct_brep.Vertices, Index=0, Wrap=True)  # -> Item, Item1, Item2
move_7 = Move(Geometry=planar_2, Motion=unit_y)  # -> Geometry, Transform
deconstruct_brep_2 = DeconstructBrep(Brep=move_7.Geometry)  # -> Faces, Edges, Vertices
list_item_3 = ListItem(List=deconstruct_brep_2.Vertices, Index=0, Wrap=True)  # -> Item, Item1, Item2
move_8 = Move(Geometry=[construct_point_2, construct_point_3, construct_point_5], Motion=unit_y)  # -> Geometry, Transform
move_9 = Move(Geometry=[line, line_2, line_4, line_5, line_3], Motion=unit_y)  # -> Geometry, Transform
line_30 = Line(StartPoint=construct_point_3, EndPoint=move_3.Geometry)
line_31 = Line(StartPoint=move_3.Geometry, EndPoint=list_item_3.Item)
line_32 = Line(StartPoint=construct_point_3, EndPoint=list_item_3.Item)
line_33 = Line(StartPoint=move_3.Geometry, EndPoint=construct_point_2)
line_34 = Line(StartPoint=move_3.Geometry, EndPoint=list_item_2.Item)
line_35 = Line(StartPoint=list_item_2.Item, EndPoint=construct_point_2)
line_36 = Line(StartPoint=move_5.Geometry, EndPoint=construct_point_3)
line_37 = Line(StartPoint=move_5.Geometry, EndPoint=list_item_3.Item)
X = UnitX(Factor=series)
boundary_surfaces = BoundarySurfaces(Edges=[line_6, line_8, line_10])
boundary_surfaces_2 = BoundarySurfaces(Edges=[line_6, line_9, line_11])
boundary_surfaces_3 = BoundarySurfaces(Edges=[line_7, line_13, line_15])
boundary_surfaces_4 = BoundarySurfaces(Edges=[line_7, line_12, line_14])
boundary_surfaces_5 = BoundarySurfaces(Edges=[line_29, line_18, line_19])
boundary_surfaces_6 = BoundarySurfaces(Edges=[line_29, line_20, line_21])
boundary_surfaces_7 = BoundarySurfaces(Edges=[line_28, line_22, line_23])
boundary_surfaces_8 = BoundarySurfaces(Edges=[line_28, line_24, line_25])

# ---- group: MOV X
move_10 = Move(Geometry=graft(point_11), Motion=X)  # -> Geometry, Transform
move_11 = Move(Geometry=planar_3, Motion=X)  # -> Geometry, Transform
move_12 = Move(Geometry=planar_4, Motion=X)  # -> Geometry, Transform
move_13 = Move(Motion=X)  # -> Geometry, Transform

# ----
loft = Loft(
    Curves=[line_30, line_31, line_32],
    Options={Adjust=False, Closed=False, LoftEnds=0, LoftSimp=0, LoftType=0, Rebuild=10, Refit=0.01})
loft_2 = Loft(
    Curves=[line_37, line_36, line_32],
    Options={Adjust=False, Closed=False, LoftEnds=0, LoftSimp=0, LoftType=0, Rebuild=10, Refit=0.01})
custom_preview = CustomPreview(
    Geometry=[boundary_surfaces, boundary_surfaces_2, boundary_surfaces_3, boundary_surfaces_4],
    Material=ColourSwatch(SwatchColor=RGB(234, 255, 0)))
custom_preview_2 = CustomPreview(
    Geometry=[boundary_surfaces_5, boundary_surfaces_6, boundary_surfaces_7, boundary_surfaces_8],
    Material=ColourSwatch(SwatchColor=RGB(29, 67, 240)))

sqrt_4 = SquareRoot(Value="3")
division_5 = Division(A=sqrt_4, B="2")
division_6 = Division(A=edge, B="2")
multiplication_6 = Multiplication(A=edge, B=division_5)

vec = VectorXYZ(XComponent=division_6, YComponent=multiplication_6, ZComponent=0)  # -> Vector, Length
number_slider_3 = Slider(1.5, range=0..10)
negative_3 = Negative(Value=number_slider_3)
multiplication_7 = Multiplication(A=number_slider_3, B=3)
multiplication_8 = Multiplication(A=number_slider_3, B=4)
multiplication_9 = Multiplication(A=number_slider_3, B=2)
construct_point_10 = ConstructPoint(XCoordinate=negative_3, YCoordinate=multiplication_7, ZCoordinate=multiplication_9)
construct_point_11 = ConstructPoint(XCoordinate=0, YCoordinate=multiplication_8, ZCoordinate=0)
construct_point_12 = ConstructPoint(XCoordinate=number_slider_3, YCoordinate=multiplication_7, ZCoordinate=multiplication_9)
construct_point_13 = ConstructPoint(XCoordinate=number_slider_3, YCoordinate=number_slider_3, ZCoordinate=multiplication_9)
construct_point_14 = ConstructPoint(XCoordinate=negative_3, YCoordinate=number_slider_3, ZCoordinate=multiplication_9)
construct_point_15 = ConstructPoint(XCoordinate=0, YCoordinate=0, ZCoordinate=0)
construct_point_16 = ConstructPoint(XCoordinate=0, YCoordinate=multiplication_9, ZCoordinate=0)
line_38 = Line(StartPoint=construct_point_16, EndPoint=construct_point_10)
line_39 = Line(StartPoint=construct_point_10, EndPoint=construct_point_11)
line_40 = Line(StartPoint=construct_point_11, EndPoint=construct_point_16)
line_41 = Line(StartPoint=construct_point_12, EndPoint=construct_point_11)
line_42 = Line(StartPoint=construct_point_11, EndPoint=construct_point_16)
line_43 = Line(StartPoint=construct_point_16, EndPoint=construct_point_12)

# ---- group: Triângulo direto
line_44 = Line(StartPoint=construct_point_13, EndPoint=construct_point_16)
line_45 = Line(StartPoint=construct_point_13, EndPoint=construct_point_15)
line_46 = Line(StartPoint=construct_point_15, EndPoint=construct_point_16)

# ---- group: Triângulo esquerdo
line_47 = Line(StartPoint=construct_point_14, EndPoint=construct_point_16)
line_48 = Line(StartPoint=construct_point_16, EndPoint=construct_point_15)
line_49 = Line(StartPoint=construct_point_15, EndPoint=construct_point_14)

# ----
boundary_surfaces_9 = BoundarySurfaces(Edges=[line_44, line_45, line_46])
boundary_surfaces_10 = BoundarySurfaces(Edges=[line_47, line_48, line_49])
boundary_surfaces_11 = BoundarySurfaces(Edges=[line_38, line_39, line_40])
boundary_surfaces_12 = BoundarySurfaces(Edges=[line_41, line_42, line_43])
point_list = PointList(
    Points=[construct_point_13, construct_point_14, construct_point_15, construct_point_16, construct_point_11, construct_point_10, construct_point_12],
    Size=Slider(0.47, range=0..10))

sqrt_5 = SquareRoot(Value="3")

multiplication_10 = Multiplication(A=sqrt_5, B=edge)

series_2 = Series(Start="0", Step=multiplication_10, Count=tetrahedron_y)

Y = UnitY(Factor=series_2)

# ---- group: MOV Y 1
move_14 = Move(Geometry=graft(move_10.Geometry), Motion=Y)  # -> Geometry, Transform
move_15 = Move(Geometry=graft(move_11.Geometry), Motion=Y)  # -> Geometry, Transform
move_16 = Move(Geometry=graft(move_13.Geometry), Motion=Y)  # -> Geometry, Transform
move_17 = Move(Geometry=graft(move_12.Geometry), Motion=Y)  # -> Geometry, Transform

# ---- group: MOV Y 2
move_18 = Move(Geometry=move_14.Geometry, Motion=vec.Vector)  # -> Geometry, Transform
move_19 = Move(Geometry=move_16.Geometry, Motion=vec.Vector)  # -> Geometry, Transform
move_20 = Move(Geometry=move_15.Geometry, Motion=vec.Vector)  # -> Geometry, Transform
move_21 = Move(Geometry=move_17.Geometry, Motion=vec.Vector)  # -> Geometry, Transform

# ----
sqrt_6 = SquareRoot(Value="3")
sqrt_7 = SquareRoot(Value="6")
division_7 = Division(A=sqrt_6, B="6")
division_8 = Division(A=sqrt_7, B="3")

multiplication_11 = Multiplication(A=division_7, B=edge)
multiplication_12 = Multiplication(A=division_8, B=edge)

vec_2 = VectorXYZ(XComponent=division_6, YComponent=multiplication_11, ZComponent=multiplication_12)  # -> Vector, Length

# ---- group: MOV Z
move_22 = Move(
    Geometry=[move_20.Geometry, move_21.Geometry, move_19.Geometry, move_18.Geometry, move_15.Geometry, move_17.Geometry, move_16.Geometry, move_14.Geometry],
    Motion=vec_2.Vector)  # -> Geometry, Transform

# ----
move_23 = Move(Geometry=move_22.Geometry, Motion=vec_2.Vector)  # -> Geometry, Transform
move_24 = Move(Geometry=move_23.Geometry, Motion=vec_2.Vector)  # -> Geometry, Transform
